# Grasshopper definition Robotic_Extruding.gh (Grasshopper 1.0.7)
# plug-ins: Robots

name_of_the_program = Panel("ABB_3Dprinting")

# ---- group: Tool Data
panel = Panel("204,0,40")
name_of_your_tool = Panel("Shiva")

# ---- group: inputs
tool_center_point = Point(panel)
points = Point(Tree({0;0}: [Point(456, -290, 0), Point(455.9216614, -292.7977295, 0), Point(455.6800537, -295.6474609, 0), Point(455.213623, -298.8329468, 0), Point(454.5271912, -302.0462036, 0), Point(452.5806885, -308.1724854, 0)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], {0;1}: [Point(456, -290, 3), Point(455.8988953, -286.8217773, 3), Point(455.585968, -283.5788574, 3), Point(454.5747314, -278.2399414, 3), Point(454.0762817, -276.3473267, 3), Point(452.2511597, -271.0044861, 3)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], {0;2}: [Point(454.3586121, -277.2938538, 6), Point(454.7908508, -279.1860291, 6), Point(455.585968, -283.5788574, 6), Point(455.8988953, -286.8217773, 6), Point(456, -290, 6), Point(455.9216614, -292.7977295, 6)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], {0;3}: [Point(454.3586121, -277.2938538, 9), Point(453.5116211, -274.4542725, 9), Point(452.2511597, -271.0044861, 9), Point(449.2754211, -264.9553223, 9), Point(445.510498, -259.3581848, 9), Point(440.9851685, -254.2783356, 9)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], {0;4}: [Point(456, -290, 12), Point(455.9216614, -292.7977295, 12), Point(455.6800537, -295.6474609, 12), Point(455.213623, -298.8329468, 12), Point(454.5271912, -302.0462036, 12), Point(452.5806885, -308.1724854, 12)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], {0;5}: [Point(454.3586121, -277.2938538, 15), Point(453.417511, -274.1387634, 15), Point(452.2511597, -271.0044861, 15), Point(450.0745544, -266.4509583, 15), Point(449.2754211, -264.9553223, 15), Point(448.3845215, -263.5288391, 15)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]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))
custom_commands = Data(Tree({0;0}: [null x66], {0;1}: [null x73], {0;2}: [null x82], {0;3}: [null x86], {0;4}: [null x88], {0;5}: [null x93]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))
extruder_mesh = Mesh(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)
number_slider = Slider(100, range=0..100)
list = ValueList({"AA-KR60", "AA-KR30", "AA-KR60_KR30", "AARCH IRB120", "AARCH IRB6620", "Bartlett-IRB120", "Bartlett-IRB1600", "Bartlett-KR6", "Bartlett-KR60", "Bartlett-UR10", "Bigli-KR20", "ETH-Gantry", "Grymsdyke-IRB120", "Grymsdyke-KR210", "iaac-KR150-2_110", "iaac-IRB140", "iaac-IRB120", "EXArchitects-IRB6700", "KULeuven-IRB120", "KULeuven-UR5", "KULeuven-UR10", "IRB4600-205", "UEL IRB6620", "uem-IRB120", "uem-IRB1600", "uem-IRB2600", "uem-IRB1600_IRB2600", "UniMelb-IRB120", "UniMelb-IRB1200"}, selected="iaac-IRB120")
number_slider_2 = Slider(0.646, range=0..1)

# ---- group: Tool Data (continued)
yz = YZPlane(Origin=tool_center_point)
rot3d = Rotate3D(Geometry=yz, Angle=degrees(180), Center=yz, Axis=Vector(0, 398.9567354, 0))  # -> Geometry, Transform
prot = RotatePlane(Plane=rot3d.Geometry, Angle=degrees("-135"))
tool = CreateTool(Name=name_of_your_tool, TCP=prot, Weight=0, Centroid=Point(20, 0, 52), Mesh=extruder_mesh)  # -> Tool, TCP

# ----
xy = XYPlane(Origin=points)
flatten = FlattenTree(Tree=xy, Path="{0}")
flatten_2 = FlattenTree(Tree=custom_commands, Path="{0}")

# ---- group: 01-Starting Offset
item = ListItem(List=flatten, Index="0", Wrap=True)
move = Move(Geometry=item, Motion="0,0,50")  # -> Geometry, Transform
list_2 = ValueList({"Joint", "Linear"}, selected="Joint")
target = CreateTarget(Plane=move.Geometry, Motion=list_2, Tool=tool.Tool, Speed="100", Zone="20", IsCartesian=True)

# ---- group: Robot Data
pt = ConstructPoint(XCoordinate=0, YCoordinate=0, ZCoordinate=0)
xy_2 = XYPlane(Origin=pt)
load_robot = LoadRobotSystem(Name=list, Base=xy_2)

# ---- group: 00 -Start | End Position
merge = Merge(Data1="0", Data2="0", Data3="0", Data4="0", Data5="0", Data6="0")
degtorad = DegreesToRadians(Degrees=merge, RobotSystem=load_robot, MechanicalGroup=0)
target_2 = CreateTarget(Joints=degtorad, Tool=tool.Tool, Speed="60", Zone="10", IsCartesian=False)

# ----
num = Number(number_slider)

# ---- group: 02-Printing Start
item_2 = ListItem(List=flatten, Index="0", Wrap=True)
item_3 = ListItem(List=flatten_2, Index="0", Wrap=True)
setdo = SetDO(DO="0", Value=Toggle(True))
wait = Wait(Time="1")
wait_2 = Wait(Time="5")
merge_2 = Merge(Data1=wait, Data2=setdo, Data3=item_3, Data4=wait_2)
list_3 = ValueList({"Joint", "Linear"}, selected="Linear")
groupcmd = GroupCommand(Commands=merge_2)
target_3 = CreateTarget(Plane=item_2, Motion=list_3, Tool=tool.Tool, Speed=num, Zone="5", Command=groupcmd, IsCartesian=True)

# ----
num_2 = Number(number_slider)

# ---- group: 03 - Printing
panel_2 = Panel("""0
-1""")
cull_i = CullIndex(List=flatten, Indices=panel_2, Wrap=True)
cull_i_2 = CullIndex(List=flatten_2, Indices=panel_2, Wrap=True)
list_4 = ValueList({"Joint", "Linear"}, selected="Linear")
target_4 = CreateTarget(Plane=cull_i, Motion=list_4, Tool=tool.Tool, Speed=num_2, Zone="5", Command=cull_i_2, IsCartesian=True)

# ----
num_3 = Number(number_slider)

# ---- group: 04-Printing End
item_4 = ListItem(List=flatten_2, Index="-1", Wrap=True)
item_5 = ListItem(List=flatten, Index="-1", Wrap=True)
setdo_2 = SetDO(DO="0", Value=Toggle(False))
wait_3 = Wait(Time="2")
merge_3 = Merge(Data1=setdo_2, Data2=item_4, Data3=wait_3)
list_5 = ValueList({"Joint", "Linear"}, selected="Linear")
groupcmd_2 = GroupCommand(Commands=merge_3)
target_5 = CreateTarget(Plane=item_5, Motion=list_5, Tool=tool.Tool, Speed=num_3, Zone="5", Command=groupcmd_2, IsCartesian=True)

# ----
entwine = Entwine(
    Branch00=target_2,
    Branch01=target,
    Branch02=target_3,
    Branch03=target_4,
    Branch04=target_5,
    Branch05=target_2,
    FlattenInputs=True)  # -> flatten(Result)
program = CreateProgram(Name=name_of_the_program, RobotSystem=load_robot, Targets1=flatten(entwine), StepSize=1)  # -> Program, Code, Duration, Warnings, Errors
sim = ProgramSimulation(Program=program.Program, Time=number_slider_2, Normalized=True)  # -> SystemMeshes, JointRotations, Plane, Index, Time, Program, Errors

# ---- group: Output
split = SplitList(List=sim.SystemMeshes, Index="7")  # -> ListA, ListB
preview = CustomPreview(Geometry=split.ListA, Shader=ColourSwatch(SwatchColor=RGB(199, 199, 199)))
preview_2 = CustomPreview(Geometry=split.ListB, Shader=ColourSwatch(SwatchColor=RGB(135, 135, 135)))

panel_3 = Panel(program.Code)

panel_4 = Panel(program.Errors)
